# Grasshopper definition potencial_construtivo_02.gh (Grasshopper 1.0.7)

largura_pavimento_tipo = Slider(17.1, range=6..50)

# ----
# TAREFAS:
# 
# 1 - todos os imputs deverão ser dados a partir de uma planilha de excel;
# 
# 2 - automatizar todo o algoritmo em programação textual;
# Terreno
dimensão_frontal = Slider(30, range=0..100)
dimensão_lateral = Slider(40, range=0..100)
panel = Panel("0")
python = PythonScript(frente=dimensão_frontal, lateral=dimensão_lateral)  # -> out, a
# ---------- python: Python ----------
import rhinoscriptsyntax as rs
import Rhino

# Given these two corner points
pt0 = Rhino.Geometry.Point3d(0, frente, 0)
pt2 = Rhino.Geometry.Point3d(lateral, 0, 0)

# Compute the other corner points
pt1 = [pt2[0], pt0[1], 0]
pt3 = [pt0[0], pt2[1], 0]

# Create a list with all the points
rect = []
rect.append(pt0)
rect.append(pt1)
rect.append(pt2)
rect.append(pt3)
rect.append(pt0) # We want a closed polyline

# Create the rectangle
a = rs.AddPolyline(rect)
# ---------- end python ----------

# ---- group: PAVTO TIPO
frontal = Slider(5, range=5..10)
lateral_e = Slider(1.5, range=1.5..50)
fundos = Slider(1.5, range=1.5..50)
lateral_d = Slider(1.5, range=1.5..50)
afast_progressivo = Slider(1.5, range=0..2)
coeficiente_de_aproveitamento = Slider(1.7, range=1..4)
altura_pavimento_tipo = Slider(3, range=2.2..6)

# ---- group: ÁREAS COMUNS
área_circulação = Slider(10, range=10..50)
área_escada = Slider(23.3, range=10..50)

# ----
área_dos_apartamentos = Slider(45, range=40..75)
quantidade_apartamentos_por_andar = Slider(3, range=1..10)

# ---- group: PAVTO GARAGEM
af_frontal = Slider(5, range=5..10)
af_lateral_e = Slider(0, range=0..50)
af_fundos = Slider(0, range=0..50)
af_lateral_d = Slider(0, range=0..50)

quant_pavtos_garagem = Slider(1, range=1..5)
altura_pavto_garagem = Slider(2.4, range=2.2..6)
vagas_por_apartamento = Slider(1, range=0..6)
área_média_por_vaga = Slider(20, range=0..50)

# ----
subtraction = Subtraction(A=dimensão_lateral, B=fundos)
subtraction_2 = Subtraction(A=dimensão_frontal, B=lateral_d)
pt = ConstructPoint(XCoordinate=frontal, YCoordinate=lateral_e, ZCoordinate=0)
pt_2 = ConstructPoint(XCoordinate=subtraction, YCoordinate=subtraction_2, ZCoordinate=0)
galapagos = Galapagos(fitness=num, gene=[área_circulação, área_escada, largura_pavimento_tipo, quantidade_apartamentos_por_andar])
# https://developer.rhino3d.com/api/RhinoScriptSyntax/#collapse-ExplodeCurves
# 
# 
# https://discourse.mcneel.com/t/mondrian-subdivision-through-points/113943
# 
# 
# https://scipython.com/blog/quadtrees-2-implementation-in-python/
# 
# https://www.grasshopper3d.com/forum/topics/divide-into-rectangles?page=1&commentId=2985220%3AComment%3A1782136&x=1#2985220Comment1782136
python_2 = PythonScript(frente=dimensão_frontal, lateral=dimensão_lateral, x=pt, y=pt_2)  # -> out, terreno, aproveitamento; inputs x: Point3d, y: Point3d
# ---------- python_2: Python ----------
import rhinoscriptsyntax as rs

plane = rs.WorldXYPlane()

def rectangle(width, height):
    'AddRectangle(plane, width, height)'
    return rs.AddRectangle(rs.WorldXYPlane(), width, height)




terreno = rectangle(lateral, frente)
aproveitamento = rectangle(y, x)
# ---------- end python_2 ----------
patch = Patch(Curves=python.a, Spans=20, Flexibility=1, Trim=True)
python_3 = PythonScript(comprimento=dimensão_frontal, largura=dimensão_lateral, CA=coeficiente_de_aproveitamento)  # -> out, AT, PCP
# ---------- python_3: Python ----------
AT = comprimento * largura
PCP = AT * CA
# ---------- end python_3 ----------
python_4 = GhPythonScript()  # -> out, a; unedited script template
rec = Rectangle(python_2.aproveitamento)
potencial_construtivo_permitido = Panel(python_3.PCP)
área_terreno = Panel(python_3.AT)
area = Area(Geometry=rec)  # -> Area, Centroid
panel_2 = Panel(area.Area)
preview = CustomPreview(Geometry=patch, Shader=ColourSwatch(SwatchColor=RGBA(143, 134, 134, 180)))
subtraction_3 = Subtraction(A=dimensão_lateral, B=fundos)
subtraction_4 = Subtraction(A=dimensão_frontal, B=lateral_d)

# ----
# Afastamentos iniciais
pt_3 = ConstructPoint(XCoordinate=frontal, YCoordinate=lateral_e, ZCoordinate=0)
pt_4 = ConstructPoint(XCoordinate=subtraction_3, YCoordinate=subtraction_4, ZCoordinate=0)
python_5 = PythonScript(x=pt_3, y=pt_4)  # -> out, a; inputs x: Point3d, y: Point3d
# ---------- python_5: Python ----------
import rhinoscriptsyntax as rs
import Rhino

# Given these two corner points
pt0 = x
pt2 = y

# Compute the other corner points
pt1 = [pt2[0], pt0[1], 0]
pt3 = [pt0[0], pt2[1], 0]

# Create a list with all the points
rect = []
rect.append(pt0)
rect.append(pt1)
rect.append(pt2)
rect.append(pt3)
rect.append(pt0) # We want a closed polyline

# Create the rectangle
a = rs.AddPolyline(rect)
# ---------- end python_5 ----------

addition = Addition()
multiplication = Multiplication(A=quant_pavtos_garagem, B=altura_pavto_garagem)
subtraction_5 = Subtraction(A=dimensão_lateral, B=af_fundos)
subtraction_6 = Subtraction(A=dimensão_frontal, B=af_lateral_d)

# ---- group: DIMENSÕES PAVTO TIPO E NÚMERO DE PAVIMENTOS
multiplication_2 = Multiplication(A=área_dos_apartamentos, B=quantidade_apartamentos_por_andar)
área_com_escada = Addition(A=multiplication_2, B=área_escada)
áárea_da_lâmina_sem_escada = Addition(A=multiplication_2, B=área_circulação)
área_da_lâmina_sem_escada = Panel(áárea_da_lâmina_sem_escada)
área_da_lâmica_com_escada = Panel(área_com_escada)
division = Division(A=área_da_lâmica_com_escada, B=largura_pavimento_tipo)
division_2 = Division(A=potencial_construtivo_permitido, B=área_da_lâmina_sem_escada)
número_pavimentos = Panel(division_2)
comprimento_do_edifício = Panel(division)
int = Integer(número_pavimentos)

# ----
multiplication_3 = Multiplication(A=afast_progressivo, B=int)
multiplication_4 = Multiplication(A=área_da_lâmina_sem_escada, B=int)
multiplication_5 = Multiplication(A=int, B=quantidade_apartamentos_por_andar)

# ----
# Afastamentos finais
acréscimo_de_afast = Panel(multiplication_3)
addition_2 = Addition(A=acréscimo_de_afast, B=lateral_e)
addition_3 = Addition(A=fundos, B=acréscimo_de_afast)
addition_4 = Addition(A=acréscimo_de_afast, B=frontal)
addition_5 = Addition(A=acréscimo_de_afast, B=lateral_d)
afast_frontal_final = Panel(addition_4)
pt_5 = ConstructPoint(XCoordinate=afast_frontal_final, YCoordinate=addition_2, ZCoordinate=0)

subtraction_7 = Subtraction(A=[dimensão_frontal, dimensão_lateral], B=addition_3)
subtraction_8 = Subtraction(A=dimensão_frontal, B=addition_5)

pt_6 = ConstructPoint(XCoordinate=subtraction_7, YCoordinate=subtraction_8, ZCoordinate=0)

python_6 = PythonScript(x=pt_5, y=pt_6)  # -> out, a; inputs x: Point3d, y: Point3d; same code as python_5

# ----
# Potencial e
# área construida
total_área_construída = Panel(multiplication_4)
potêncial_construtivo_permitido = Panel(potencial_construtivo_permitido)
potencial_construtivo_permitido_2 = Panel(potencial_construtivo_permitido)

division_3 = Division(A=total_área_construída, B=área_terreno)

potencial_construtivo_utilizado = Panel(division_3)

division_4 = Division(A=total_área_construída, B=potêncial_construtivo_permitido)
larger = LargerThan(FirstNumber=division_4, SecondNumber=Slider(0.94, range=0..1))  # -> LargerThan, OrEqualTo
dispatch = Dispatch(List=division_4, DispatchPattern=larger.OrEqualTo)  # -> ListA, ListB
smaller = SmallerThan(FirstNumber=dispatch.ListA, SecondNumber=Slider(1, range=0..1))  # -> SmallerThan, OrEqualTo
dispatch_2 = Dispatch(List=dispatch.ListA, DispatchPattern=smaller.OrEqualTo)  # -> ListA, ListB
division_5 = Division(A=int, B=dispatch_2.ListA)
num = Number(division_5)

panel_3 = Panel(dispatch_2.ListA)
# FITNESS: Qual é a melhor área e número de apartametos por andar para o melhor aproveitamento do potencial construtivo e o maior número de andares?
valor_fitness = Panel(division_5)

# ----
# Áreas
número_andares = Panel(int)
total_apartamentos = Panel(multiplication_5)

multiplication_6 = Multiplication(A=vagas_por_apartamento, B=total_apartamentos)

vagas_garagem_necessárias = Panel(multiplication_6)

area_2 = Area(Geometry=python_6.a)  # -> Area, Centroid
preview_2 = CustomPreview(Geometry=python_6.a, Shader=ColourSwatch(SwatchColor=RGB(0, 0, 0)))

# ---- group: DIMENSÕES PAVTO TIPO E NÚMERO DE PAVIMENTOS (continued)
rectangle = Rectangle(Plane=area_2.Centroid, XSize=largura_pavimento_tipo, YSize=comprimento_do_edifício, Radius=0)  # -> Rectangle, Length
area_3 = Area(Geometry=rectangle.Rectangle)  # -> Area, Centroid

# ----
orient = Orient(Geometry=rectangle.Rectangle, Source=area_3.Centroid, Target=area_2.Centroid)  # -> Geometry, Transform

# ---- group: projeção construção
projeção = CustomPreview(Geometry=orient.Geometry, Shader=ColourSwatch(SwatchColor=RGB(0, 0, 0)))

# ----
# - pavimento (s) tipo (s);
# - projeção pavimento (s) tipo (s).
Z = UnitZ(Factor=multiplication)
move = Move(Geometry=orient.Geometry, Motion=Z)  # -> Geometry, Transform
boxrec = BoxRectangle(Rectangle=move.Geometry, Height=altura_pavimento_tipo)
Z_2 = UnitZ(Factor=altura_pavimento_tipo)
arrlinear = LinearArray(Geometry=boxrec, Direction=Z_2, Count=int)  # -> Geometry, Transform
preview_3 = CustomPreview(Geometry=arrlinear.Geometry, Shader=ColourSwatch(SwatchColor=RGBA(167, 166, 247, 188)))

# ----
# Pavimento (s) garagem (s)
pt_7 = ConstructPoint(XCoordinate=subtraction_5, YCoordinate=subtraction_6, ZCoordinate=0)
pt_8 = ConstructPoint(XCoordinate=af_frontal, YCoordinate=af_lateral_e, ZCoordinate=0)
Z_3 = UnitZ(Factor=altura_pavto_garagem)

python_7 = PythonScript(x=pt_8, y=pt_7)  # -> out, a; inputs x: Point3d, y: Point3d; same code as python_5

area_4 = Area(Geometry=python_7.a)  # -> Area, Centroid
boxrec_2 = BoxRectangle(Rectangle=python_7.a, Height=altura_pavto_garagem)
arrlinear_2 = LinearArray(Geometry=boxrec_2, Direction=Z_3, Count=quant_pavtos_garagem)  # -> Geometry, Transform
preview_4 = CustomPreview(Geometry=arrlinear_2.Geometry, Shader=ColourSwatch(SwatchColor=RGBA(255, 225, 150, 176)))

subtraction_9 = Subtraction(A=área_terreno, B=area_4.Area)
multiplication_7 = Multiplication(A=area_4.Area, B=quant_pavtos_garagem)

área_solo_natural_alcançado = Panel(subtraction_9)
área_total_pavimentos_garagem = Panel(multiplication_7)

division_6 = Division(A=área_solo_natural_alcançado, B=área_terreno)
multiplication_8 = Multiplication(A=division_6, B=100)

division_7 = Division(A=área_total_pavimentos_garagem, B=área_média_por_vaga)
área_total_pavtos_garagem = Panel(multiplication_7)

área_solo_natural_alcançada = Panel(multiplication_8)
vagas_garagem_possíveis = Panel(division_7)
